# Grasshopper definition metamaterial-simulation.gh (Grasshopper 0.9.76)
# plug-ins: Karamba, OutputComponent, InputComponent

metain = InputComponent()  # -> Vertices, Line, AnchorPoints, LoadPoint, LoadForce
panel = Panel(metain.LoadForce)
number_slider = Slider(10, range=-10..10)
X = UnitX(Factor=number_slider)
Y = UnitY(Factor=number_slider)
Z = UnitZ(Factor=number_slider)
readmattable = ReadMaterialTableFromFileKaramba()
line = Line(metain.Line)
rdpoints = RemoveDuplicatePointsKaramba(Point=metain.AnchorPoints, LimitDistance=0.005)  # -> OutPoint, Info, Indexes
multiplication = Multiplication(A=metain.LoadForce, B=number_slider)
pt = Point(metain.LoadPoint)
rdlines = RemoveDuplicateLinesKaramba(Line=line, LimitDistance=0.005)  # -> OutLine, Info, Indexes
panel_2 = Panel(metain.Vertices)
panel_3 = Panel(readmattable)
pt_2 = Point(rdpoints.OutPoint)
pt_3 = Point(metain.Vertices)
loads = LoadsKaramba(ForceVector=multiplication, Local=False, PosInd=pt, LCase=0, mode="Point")
linetobeam = LineToBeamKaramba(Line=rdlines.OutLine, New=True, Remove=True, LimitDistance_m=0.005)  # -> Points, Element, Info
supp = SupportKaramba(PosInd=pt_2, menu=[buttons(on, on, on, on, on, on)])
matprops = MaterialPropertiesKaramba(
    YoungsModulus_kN_cm2=22.4,
    ShearModulus_kN_cm2=10,
    SpecificWeight_kN_m3=20,
    CoefficientOfThermalExpansion_1_C=1e-05,
    YieldStrength_kN_cm2=2,
    Name="ABS")
panel_4 = Panel(matprops)
assemble = AssembleModelKaramba(Point=pt_3, Elem=linetobeam.Element, Support=supp, Load=loads, Material=matprops, LimitDistance_m=0.005)  # -> Model, Info, Mass_kg, CenterOfGravity
ladeform = LargeDeformationAnalysisKaramba(Model=assemble.Model, Iterations=50, MaximumDisplacement_m=-1)  # -> CalculatedModel, MaximumDisplacement_m
panel_5 = Panel(ladeform.MaximumDisplacement_m)
analyzethi = AnalyzeThIKaramba(Model=ladeform.CalculatedModel)  # -> CalculatedModel, MaximumDisplacement_m, ResultingForceOfGravity_kN, ElasticEnergy_kNm
modelview = ModelViewKaramba(Model=ladeform.CalculatedModel, LoadCaseFactorsForLinearSuperposition=1, IndexIncrementOfVisibleLoadcase=0)  # -> Model, DeformedMesh, DeformedAxes, DeformedModel
cross_sections = CrossSectionsKaramba(mode="Spring")
crv = Curve(modelview.DeformedAxes)
line_2 = Line(crv)
disassemble = DisassembleModelKaramba(Model=modelview.Model)  # -> Model, Point, Beam, Shell, Support, Load, Line, Mesh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
pt_4 = Point(disassemble.Point)
metaout = OutputComponent(TansformedPoints=pt_4)
